# Grasshopper definition Nolli Canolli_ShapeDiver_Rhino7.gh (Grasshopper 1.0.7)
# plug-ins: BitmapPlus, ShapeDiverForGrasshopper, Swiftlet

c_script = CSharpScript()  # -> out, A, B, C, D, E, F, G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; inputs curves: list of Curve, gfa: Double, targetHighResArea: Double, targetLowResArea: Double, targetOpenArea: Double, targetCommunityArea: Double, targetOfficeArea: Double, targetHotelArea: Double
# ---------- c_script: C# usings ----------
using System.Linq;
using Rhino.Geometry.Intersect;
# ---------- c_script: C# ----------
    // Create a list to store the areas of closed curves
    List<double> curveAreas = new List<double>();

    // Iterate through each curve in the input list
    foreach (Curve curve in curves)
    {
      // Check if the curve is closed
      if (curve.IsClosed)
      {
        // Compute the area of the closed curve
        AreaMassProperties areaProps = AreaMassProperties.Compute(curve);

        // If the computation is successful, store the area in the list
        if (areaProps != null)
        {
          curveAreas.Add(areaProps.Area);
        }
        else
        {
          curveAreas.Add(0.0); // Add 0 if the area computation fails
        }
      }
      else
      {
        curveAreas.Add(0.0); // Add 0 if the curve is not closed
      }
    }

    // Output the list of areas to 'A'
    A = curveAreas;

    // Calculate the total sum of all areas
    double totalArea = curveAreas.Sum();

    // Calculate the total target area
    double totalTargetArea = targetHighResArea + targetLowResArea + targetOpenArea + targetCommunityArea + targetOfficeArea + targetHotelArea;

    // Create GFA proportions based on the ratio of each target area to the total target area
    double gfaHighRes = gfa * (targetHighResArea / totalTargetArea);
    double gfaLowRes = gfa * (targetLowResArea / totalTargetArea);
    double gfaOpen = gfa * (targetOpenArea / totalTargetArea);
    double gfaCommunity = gfa * (targetCommunityArea / totalTargetArea);
    double gfaOffice = gfa * (targetOfficeArea / totalTargetArea);
    double gfaHotel = gfa * (targetHotelArea / totalTargetArea);

    // Proportionate areas based on target percentage
    double highResRatio = targetHighResArea / totalTargetArea;
    double lowResRatio = targetLowResArea / totalTargetArea;
    double openRatio = targetOpenArea / totalTargetArea;
    double communityRatio = targetCommunityArea / totalTargetArea;
    double officeRatio = targetOfficeArea / totalTargetArea;
    double hotelRatio = targetHotelArea / totalTargetArea;

    // Create a list of available areas (a copy of curveAreas)
    List<double> availableAreas = new List<double>(curveAreas);

    // Assign areas to each target based on their proportional target area
    List<double> selectedHighResAreas = AssignProportionalAreas(targetHighResArea, availableAreas);
    List<double> selectedLowResAreas = AssignProportionalAreas(targetLowResArea, availableAreas);
    List<double> selectedOpenAreas = AssignProportionalAreas(targetOpenArea, availableAreas);
    List<double> selectedCommunityAreas = AssignProportionalAreas(targetCommunityArea, availableAreas);
    List<double> selectedOfficeAreas = AssignProportionalAreas(targetOfficeArea, availableAreas);
    List<double> selectedHotelAreas = AssignProportionalAreas(targetHotelArea, availableAreas);

    // Output the selected areas for each category
    B = selectedHighResAreas;
    C = selectedLowResAreas;
    D = selectedOpenAreas;
    E = selectedCommunityAreas;
    F = selectedOfficeAreas;

    // Assign hotel areas (separate ref object if needed)
    F = selectedHotelAreas;
    
    // Output the GFA for each target
    H = gfaHighRes;
    I = gfaLowRes;
    J = gfaOpen;
    K = gfaCommunity;
    L = gfaOffice;
    M = gfaHotel;
# ---------- c_script: C# additional code ----------
  // Helper function to assign areas proportionally
  List<double> AssignProportionalAreas(double targetArea, List<double> availableAreas)
  {
    double accumulatedArea = 0.0;
    List<double> selectedAreas = new List<double>();
    Random random = new Random();

    while (accumulatedArea < targetArea && availableAreas.Count > 0)
    {
      // Pick a random index from the available areas
      int randomIndex = random.Next(availableAreas.Count);
      double selectedArea = availableAreas[randomIndex];

      // Add the selected area to the accumulated area
      accumulatedArea += selectedArea;
      selectedAreas.Add(selectedArea);

      // Remove the selected area from the available list to avoid repetition
      availableAreas.RemoveAt(randomIndex);

      // Break if accumulated area exceeds or meets the target
      if (accumulatedArea >= targetArea)
      {
        break;
      }
    }

    return selectedAreas;
  }
# ---------- end c_script ----------
c_script_2 = CSharpScript()  # -> out, A, B, C, D, E, F, G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; inputs curves: list of Curve, gfa: Double, targetHighResArea: Double, targetLowResArea: Double, targetOpenArea: Double, targetCommunityArea: Double, targetOfficeArea: Double, targetHotelArea: Double
# ---------- c_script_2: C# ----------
    // Create a list to store the areas of closed curves
    List<double> curveAreas = new List<double>();

    // Iterate through each curve in the input list
    foreach (Curve curve in curves)
    {
      // Check if the curve is closed
      if (curve.IsClosed)
      {
        // Compute the area of the closed curve
        AreaMassProperties areaProps = AreaMassProperties.Compute(curve);

        // If the computation is successful, store the area in the list
        if (areaProps != null)
        {
          curveAreas.Add(areaProps.Area);
        }
        else
        {
          curveAreas.Add(0.0); // Add 0 if the area computation fails
        }
      }
      else
      {
        curveAreas.Add(0.0); // Add 0 if the curve is not closed
      }
    }

    // Output the list of areas to 'A'
    A = curveAreas;

    // Calculate the total sum of all areas
    double totalArea = curveAreas.Sum();

    // Calculate the total target area
    double totalTargetArea = targetHighResArea + targetLowResArea + targetOpenArea + targetCommunityArea + targetOfficeArea + targetHotelArea;

    // Create GFA proportions based on the ratio of each target area to the total target area
    double gfaHighRes = gfa * (targetHighResArea / totalTargetArea);
    double gfaLowRes = gfa * (targetLowResArea / totalTargetArea);
    double gfaOpen = gfa * (targetOpenArea / totalTargetArea);
    double gfaCommunity = gfa * (targetCommunityArea / totalTargetArea);
    double gfaOffice = gfa * (targetOfficeArea / totalTargetArea);
    double gfaHotel = gfa * (targetHotelArea / totalTargetArea);

    // Proportionate areas based on target percentage
    double highResRatio = targetHighResArea / totalTargetArea;
    double lowResRatio = targetLowResArea / totalTargetArea;
    double openRatio = targetOpenArea / totalTargetArea;
    double communityRatio = targetCommunityArea / totalTargetArea;
    double officeRatio = targetOfficeArea / totalTargetArea;
    double hotelRatio = targetHotelArea / totalTargetArea;

    // Create a list of available areas (a copy of curveAreas)
    List<double> availableAreas = new List<double>(curveAreas);

    // Assign areas to each target based on their proportional target area
    List<double> selectedHighResAreas = AssignProportionalAreas(targetHighResArea, availableAreas);
    List<double> selectedLowResAreas = AssignProportionalAreas(targetLowResArea, availableAreas);
    List<double> selectedOpenAreas = AssignProportionalAreas(targetOpenArea, availableAreas);
    List<double> selectedCommunityAreas = AssignProportionalAreas(targetCommunityArea, availableAreas);
    List<double> selectedOfficeAreas = AssignProportionalAreas(targetOfficeArea, availableAreas);
    List<double> selectedHotelAreas = AssignProportionalAreas(targetHotelArea, availableAreas);
    
    // Assign random percentages to each selected areas list
    List<double> highResPercentages = AssignRandomPercentages(selectedHighResAreas);
    List<double> lowResPercentages = AssignRandomPercentages(selectedLowResAreas);
    List<double> openPercentages = AssignRandomPercentages(selectedOpenAreas);
    List<double> communityPercentages = AssignRandomPercentages(selectedCommunityAreas);
    List<double> officePercentages = AssignRandomPercentages(selectedOfficeAreas);
    List<double> hotelPercentages = AssignRandomPercentages(selectedHotelAreas);

    // Output the selected areas for each category
    B = selectedHighResAreas;
    C = selectedLowResAreas;
    D = selectedOpenAreas;
    E = selectedCommunityAreas;
    F = selectedOfficeAreas;
    G = selectedHotelAreas;

    // Output the GFA for each target
    H = gfaHighRes;
    I = gfaLowRes;
    J = gfaOpen;
    K = gfaCommunity;
    L = gfaOffice;
    M = gfaHotel;
    
    // Output the percentage values
    N = highResPercentages;
    O = lowResPercentages;
    P = openPercentages;
    Q = communityPercentages;
    R = officePercentages;
    S = hotelPercentages;
# ---------- c_script_2: C# additional code ----------
  // Helper function to assign areas proportionally
  List<double> AssignProportionalAreas(double targetArea, List<double> availableAreas)
  {
    double accumulatedArea = 0.0;
    List<double> selectedAreas = new List<double>();
    Random random = new Random();

    while (accumulatedArea < targetArea && availableAreas.Count > 0)
    {
      // Pick a random index from the available areas
      int randomIndex = random.Next(availableAreas.Count);
      double selectedArea = availableAreas[randomIndex];

      // Add the selected area to the accumulated area
      accumulatedArea += selectedArea;
      selectedAreas.Add(selectedArea);

      // Remove the selected area from the available list to avoid repetition
      availableAreas.RemoveAt(randomIndex);

      // Break if accumulated area exceeds or meets the target
      if (accumulatedArea >= targetArea)
      {
        break;
      }
    }

    return selectedAreas;
  }
  
  // Helper function to assign area lists a percentage
  List<double> AssignRandomPercentages(List<double> selectedAreas)
  {
    Random random = new Random();
    List<double> randomValues = new List<double>();
    double totalRandom = 0.0;

    // Generate random values for each area
    foreach (var area in selectedAreas)
    {
      double randValue = random.NextDouble(); // Generate random number between 0 and 1
      randomValues.Add(randValue);
      totalRandom += randValue; // Sum up all random values
    }

    // Normalize the random values so their sum is 100%
    List<double> percentageValues = new List<double>();
    foreach (var randValue in randomValues)
    {
      double percentage = (randValue / totalRandom) * 100.0; // Convert to percentage
      percentageValues.Add(percentage);
    }

    return percentageValues;
  }
# ---------- end c_script_2 ----------
c_script_3 = CSharpScript()  # -> out, A, B, C, D, E, F, G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; inputs curves: list of Curve, gfa: Double, targetHighResArea: Double, targetLowResArea: Double, targetOpenArea: Double, targetCommunityArea: Double, targetOfficeArea: Double, targetHotelArea: Double
# ---------- c_script_3: C# ----------
    // Create a list to store the areas of closed curves
    List<double> curveAreas = new List<double>();

    // Iterate through each curve in the input list
    foreach (Curve curve in curves)
    {
      // Check if the curve is closed
      if (curve.IsClosed)
      {
        // Compute the area of the closed curve
        AreaMassProperties areaProps = AreaMassProperties.Compute(curve);

        // If the computation is successful, store the area in the list
        if (areaProps != null)
        {
          curveAreas.Add(areaProps.Area);
        }
        else
        {
          curveAreas.Add(0.0); // Add 0 if the area computation fails
        }
      }
      else
      {
        curveAreas.Add(0.0); // Add 0 if the curve is not closed
      }
    }

    // Output the list of areas to 'A'
    A = curveAreas;

    // Calculate the total sum of all areas
    double totalArea = curveAreas.Sum();

    // Calculate the total target area
    double totalTargetArea = targetHighResArea + targetLowResArea + targetOpenArea + targetCommunityArea + targetOfficeArea + targetHotelArea;

    // Create GFA proportions based on the ratio of each target area to the total target area
    double gfaHighRes = gfa * (targetHighResArea / totalTargetArea);
    double gfaLowRes = gfa * (targetLowResArea / totalTargetArea);
    double gfaOpen = gfa * (targetOpenArea / totalTargetArea);
    double gfaCommunity = gfa * (targetCommunityArea / totalTargetArea);
    double gfaOffice = gfa * (targetOfficeArea / totalTargetArea);
    double gfaHotel = gfa * (targetHotelArea / totalTargetArea);

    // Proportionate areas based on target percentage
    double highResRatio = targetHighResArea / totalTargetArea;
    double lowResRatio = targetLowResArea / totalTargetArea;
    double openRatio = targetOpenArea / totalTargetArea;
    double communityRatio = targetCommunityArea / totalTargetArea;
    double officeRatio = targetOfficeArea / totalTargetArea;
    double hotelRatio = targetHotelArea / totalTargetArea;

    // Create a list of available areas (a copy of curveAreas)
    List<double> availableAreas = new List<double>(curveAreas);

    // Assign areas to each target based on their proportional target area
    List<double> selectedHighResAreas = AssignProportionalAreas(targetHighResArea, availableAreas);
    List<double> selectedLowResAreas = AssignProportionalAreas(targetLowResArea, availableAreas);
    List<double> selectedOpenAreas = AssignProportionalAreas(targetOpenArea, availableAreas);
    List<double> selectedCommunityAreas = AssignProportionalAreas(targetCommunityArea, availableAreas);
    List<double> selectedOfficeAreas = AssignProportionalAreas(targetOfficeArea, availableAreas);
    List<double> selectedHotelAreas = AssignProportionalAreas(targetHotelArea, availableAreas);

    // Assign random percentages to each selected areas list
    List<double> highResPercentages = AssignRandomPercentages(selectedHighResAreas);
    List<double> lowResPercentages = AssignRandomPercentages(selectedLowResAreas);
    List<double> openPercentages = AssignRandomPercentages(selectedOpenAreas);
    List<double> communityPercentages = AssignRandomPercentages(selectedCommunityAreas);
    List<double> officePercentages = AssignRandomPercentages(selectedOfficeAreas);
    List<double> hotelPercentages = AssignRandomPercentages(selectedHotelAreas);

    // Calculate GFA for each program by applying percentages to selected areas
    List<double> highResGFA = CalculateCurveGFA(gfaHighRes, highResPercentages, selectedHighResAreas);
    List<double> lowResGFA = CalculateCurveGFA(gfaLowRes, lowResPercentages, selectedLowResAreas);
    List<double> openGFA = CalculateCurveGFA(gfaOpen, openPercentages, selectedOpenAreas);
    List<double> communityGFA = CalculateCurveGFA(gfaCommunity, communityPercentages, selectedCommunityAreas);
    List<double> officeGFA = CalculateCurveGFA(gfaOffice, officePercentages, selectedOfficeAreas);
    List<double> hotelGFA = CalculateCurveGFA(gfaHotel, hotelPercentages, selectedHotelAreas);

    // Output the selected areas for each category
    B = selectedHighResAreas;
    C = selectedLowResAreas;
    D = selectedOpenAreas;
    E = selectedCommunityAreas;
    F = selectedOfficeAreas;
    G = selectedHotelAreas;

    // Output the GFA for each target
    H = gfaHighRes;
    I = gfaLowRes;
    J = gfaOpen;
    K = gfaCommunity;
    L = gfaOffice;
    M = gfaHotel;

    // Output the percentage values
    N = highResPercentages;
    O = lowResPercentages;
    P = openPercentages;
    Q = communityPercentages;
    R = officePercentages;
    S = hotelPercentages;

    // Output the GFA for each selected curve list
    T = highResGFA;
    U = lowResGFA;
    V = openGFA;
    W = communityGFA;
    X = officeGFA;
    Y = hotelGFA;
# ---------- c_script_3: C# additional code ----------
  // Helper function to assign areas proportionally
  List<double> AssignProportionalAreas(double targetArea, List<double> availableAreas)
  {
    double accumulatedArea = 0.0;
    List<double> selectedAreas = new List<double>();
    Random random = new Random();

    while (accumulatedArea < targetArea && availableAreas.Count > 0)
    {
      // Pick a random index from the available areas
      int randomIndex = random.Next(availableAreas.Count);
      double selectedArea = availableAreas[randomIndex];

      // Add the selected area to the accumulated area
      accumulatedArea += selectedArea;
      selectedAreas.Add(selectedArea);

      // Remove the selected area from the available list to avoid repetition
      availableAreas.RemoveAt(randomIndex);

      // Break if accumulated area exceeds or meets the target
      if (accumulatedArea >= targetArea)
      {
        break;
      }
    }

    return selectedAreas;
  }

  // Helper function to assign area lists a percentage
  List<double> AssignRandomPercentages(List<double> selectedAreas)
  {
    Random random = new Random();
    List<double> randomValues = new List<double>();
    double totalRandom = 0.0;

    // Generate random values for each area
    foreach (var area in selectedAreas)
    {
      double randValue = random.NextDouble(); // Generate random number between 0 and 1
      randomValues.Add(randValue);
      totalRandom += randValue; // Sum up all random values
    }

    // Normalize the random values so their sum is 100%
    List<double> percentageValues = new List<double>();
    foreach (var randValue in randomValues)
    {
      double percentage = (randValue / totalRandom) * 100.0; // Convert to percentage
      percentageValues.Add(percentage);
    }

    return percentageValues;
  }

  // Helper function to calculate GFA based on percentage assigned to each curve area
  List<double> CalculateCurveGFA(double gfa, List<double> percentages, List<double> selectedAreas)
  {
    List<double> curveGFA = new List<double>();

    for (int i = 0; i < percentages.Count; i++)
    {
      // Divide GFA by 100 and multiply by the percentage
      double areaGFA = (gfa / 100.0) * percentages[i];
      curveGFA.Add(areaGFA);
    }

    return curveGFA;
  }
# ---------- end c_script_3 ----------
c_script_4 = CSharpScript()  # -> out, A, B, C, D, E, F, G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; inputs curves: list of Curve, gfa: Double, targetHighResArea: Double, targetLowResArea: Double, targetOpenArea: Double, targetCommunityArea: Double, targetOfficeArea: Double, targetHotelArea: Double
# ---------- c_script_4: C# ----------
    // Create a list to store the areas of closed curves
    List<double> curveAreas = new List<double>();

    // Iterate through each curve in the input list
    foreach (Curve curve in curves)
    {
      // Check if the curve is closed
      if (curve.IsClosed)
      {
        // Compute the area of the closed curve
        AreaMassProperties areaProps = AreaMassProperties.Compute(curve);

        // If the computation is successful, store the area in the list
        if (areaProps != null)
        {
          curveAreas.Add(areaProps.Area);
        }
        else
        {
          curveAreas.Add(0.0); // Add 0 if the area computation fails
        }
      }
      else
      {
        curveAreas.Add(0.0); // Add 0 if the curve is not closed
      }
    }

    // Output the list of areas to 'A'
    A = curveAreas;

    // Calculate the total sum of all areas
    double totalArea = curveAreas.Sum();

    // Calculate the total target area
    double totalTargetArea = targetHighResArea + targetLowResArea + targetOpenArea + targetCommunityArea + targetOfficeArea + targetHotelArea;

    // Create GFA proportions based on the ratio of each target area to the total target area
    double gfaHighRes = gfa * (targetHighResArea / totalTargetArea);
    double gfaLowRes = gfa * (targetLowResArea / totalTargetArea);
    double gfaOpen = gfa * (targetOpenArea / totalTargetArea);
    double gfaCommunity = gfa * (targetCommunityArea / totalTargetArea);
    double gfaOffice = gfa * (targetOfficeArea / totalTargetArea);
    double gfaHotel = gfa * (targetHotelArea / totalTargetArea);

    // Proportionate areas based on target percentage
    double highResRatio = targetHighResArea / totalTargetArea;
    double lowResRatio = targetLowResArea / totalTargetArea;
    double openRatio = targetOpenArea / totalTargetArea;
    double communityRatio = targetCommunityArea / totalTargetArea;
    double officeRatio = targetOfficeArea / totalTargetArea;
    double hotelRatio = targetHotelArea / totalTargetArea;

    // Create a list of available areas (a copy of curveAreas)
    List<double> availableAreas = new List<double>(curveAreas);

    // Assign areas to each target based on their proportional target area
    List<double> selectedHighResAreas = AssignProportionalAreas(targetHighResArea, availableAreas);
    List<double> selectedLowResAreas = AssignProportionalAreas(targetLowResArea, availableAreas);
    List<double> selectedOpenAreas = AssignProportionalAreas(targetOpenArea, availableAreas);
    List<double> selectedCommunityAreas = AssignProportionalAreas(targetCommunityArea, availableAreas);
    List<double> selectedOfficeAreas = AssignProportionalAreas(targetOfficeArea, availableAreas);
    List<double> selectedHotelAreas = AssignProportionalAreas(targetHotelArea, availableAreas);

    // Assign random percentages to each selected areas list
    List<double> highResPercentages = AssignRandomPercentages(selectedHighResAreas);
    List<double> lowResPercentages = AssignRandomPercentages(selectedLowResAreas);
    List<double> openPercentages = AssignRandomPercentages(selectedOpenAreas);
    List<double> communityPercentages = AssignRandomPercentages(selectedCommunityAreas);
    List<double> officePercentages = AssignRandomPercentages(selectedOfficeAreas);
    List<double> hotelPercentages = AssignRandomPercentages(selectedHotelAreas);

    // Calculate GFA for each program by applying percentages to selected areas
    List<double> highResGFA = CalculateCurveGFA(gfaHighRes, highResPercentages, selectedHighResAreas);
    List<double> lowResGFA = CalculateCurveGFA(gfaLowRes, lowResPercentages, selectedLowResAreas);
    List<double> openGFA = CalculateCurveGFA(gfaOpen, openPercentages, selectedOpenAreas);
    List<double> communityGFA = CalculateCurveGFA(gfaCommunity, communityPercentages, selectedCommunityAreas);
    List<double> officeGFA = CalculateCurveGFA(gfaOffice, officePercentages, selectedOfficeAreas);
    List<double> hotelGFA = CalculateCurveGFA(gfaHotel, hotelPercentages, selectedHotelAreas);

    // Calculate and round up GFA for each program by dividing by the selected curve areas
    List<int> highResRoundedGFA = CalculateRoundedGFA(highResGFA, selectedHighResAreas);
    List<int> lowResRoundedGFA = CalculateRoundedGFA(lowResGFA, selectedLowResAreas);
    List<int> openRoundedGFA = CalculateRoundedGFA(openGFA, selectedOpenAreas);
    List<int> communityRoundedGFA = CalculateRoundedGFA(communityGFA, selectedCommunityAreas);
    List<int> officeRoundedGFA = CalculateRoundedGFA(officeGFA, selectedOfficeAreas);
    List<int> hotelRoundedGFA = CalculateRoundedGFA(hotelGFA, selectedHotelAreas);

    // Output the selected areas for each category
    B = selectedHighResAreas;
    C = selectedLowResAreas;
    D = selectedOpenAreas;
    E = selectedCommunityAreas;
    F = selectedOfficeAreas;
    G = selectedHotelAreas;

    // Output the GFA for each target
    H = gfaHighRes;
    I = gfaLowRes;
    J = gfaOpen;
    K = gfaCommunity;
    L = gfaOffice;
    M = gfaHotel;

    // Output the percentage values
    N = highResPercentages;
    O = lowResPercentages;
    P = openPercentages;
    Q = communityPercentages;
    R = officePercentages;
    S = hotelPercentages;

    // Output the GFA for each selected curve list
    T = highResGFA;
    U = lowResGFA;
    V = openGFA;
    W = communityGFA;
    X = officeGFA;
    Y = hotelGFA;

    // Output the rounded GFA values for each program
    Z = highResRoundedGFA;
    AA = lowResRoundedGFA;
    AB = openRoundedGFA;
    AC = communityRoundedGFA;
    AD = officeRoundedGFA;
    AE = hotelRoundedGFA;
# ---------- c_script_4: C# additional code ----------
  // Helper function to assign areas proportionally
  List<double> AssignProportionalAreas(double targetArea, List<double> availableAreas)
  {
    double accumulatedArea = 0.0;
    List<double> selectedAreas = new List<double>();
    Random random = new Random();

    while (accumulatedArea < targetArea && availableAreas.Count > 0)
    {
      // Pick a random index from the available areas
      int randomIndex = random.Next(availableAreas.Count);
      double selectedArea = availableAreas[randomIndex];

      // Add the selected area to the accumulated area
      accumulatedArea += selectedArea;
      selectedAreas.Add(selectedArea);

      // Remove the selected area from the available list to avoid repetition
      availableAreas.RemoveAt(randomIndex);

      // Break if accumulated area exceeds or meets the target
      if (accumulatedArea >= targetArea)
      {
        break;
      }
    }

    return selectedAreas;
  }

  // Helper function to assign area lists a percentage
  List<double> AssignRandomPercentages(List<double> selectedAreas)
  {
    Random random = new Random();
    List<double> randomValues = new List<double>();
    double totalRandom = 0.0;

    // Generate random values for each area
    foreach (var area in selectedAreas)
    {
      double randValue = random.NextDouble(); // Generate random number between 0 and 1
      randomValues.Add(randValue);
      totalRandom += randValue; // Sum up all random values
    }

    // Normalize the random values so their sum is 100%
    List<double> percentageValues = new List<double>();
    foreach (var randValue in randomValues)
    {
      double percentage = (randValue / totalRandom) * 100.0; // Convert to percentage
      percentageValues.Add(percentage);
    }

    return percentageValues;
  }

  // Helper function to calculate GFA based on percentage assigned to each curve area
  List<double> CalculateCurveGFA(double gfa, List<double> percentages, List<double> selectedAreas)
  {
    List<double> curveGFA = new List<double>();

    for (int i = 0; i < percentages.Count; i++)
    {
      // Divide GFA by 100 and multiply by the percentage
      double areaGFA = (gfa / 100.0) * percentages[i];
      curveGFA.Add(areaGFA);
    }

    return curveGFA;
  }

  // Helper function to calculate and round up the division of GFA by area
  List<int> CalculateRoundedGFA(List<double> gfaList, List<double> areaList)
  {
    List<int> roundedGFA = new List<int>();

    for (int i = 0; i < gfaList.Count; i++)
    {
      // Avoid division by zero by checking if area is greater than 0
      if (areaList[i] > 0)
      {
        // Divide GFA by area and round up to the nearest whole number
        double divisionResult = gfaList[i] / areaList[i];
        int roundedValue = (int) Math.Ceiling(divisionResult); // Round up
        roundedGFA.Add(roundedValue);
      }
      else
      {
        roundedGFA.Add(0); // If area is 0, add 0 to the result
      }
    }

    return roundedGFA;
  }
# ---------- end c_script_4 ----------
steps = Slider(50, range=1..70)
# Create a black and white nolli map for a city that is extremely dense, highly walkable and organic, with tiny blocks
textinput = DirectTextInput(maxlength=10000, text="2000000")
ghpython_script = GhPythonScript(prompt=textinput, steps=steps)  # -> request_body
# ---------- ghpython_script: Python ----------
import json

request_body = str({
        "inputs": prompt,
        "parameters": {
            "height": 512,
            "width": 512,
            "num_inference_steps": int(steps)
        }})
# ---------- end ghpython_script ----------
path = FilePath("C:\Users\EJain\Downloads\image (27).png")
c_script_5 = CSharpScript()  # -> out, A, B, C, D, E, F, G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; inputs curves: list of Curve, gfa: Double, targetHighResArea: Double, targetLowResArea: Double, targetOpenArea: Double, targetCommunityArea: Double, targetOfficeArea: Double, targetHotelArea: Double
# ---------- c_script_5: C# ----------
    // Create a list to store the areas of closed curves
    List<double> curveAreas = new List<double>();

    // Iterate through each curve in the input list
    foreach (Curve curve in curves)
    {
      // Check if the curve is closed
      if (curve.IsClosed)
      {
        // Compute the area of the closed curve
        AreaMassProperties areaProps = AreaMassProperties.Compute(curve);

        // If the computation is successful, store the area in the list
        if (areaProps != null)
        {
          curveAreas.Add(areaProps.Area);
        }
        else
        {
          curveAreas.Add(0.0); // Add 0 if the area computation fails
        }
      }
      else
      {
        curveAreas.Add(0.0); // Add 0 if the curve is not closed
      }
    }

    // Output the list of areas to 'A'
    A = curveAreas;

    // Calculate the total sum of all areas
    double totalArea = curveAreas.Sum();

    // Calculate the total target area
    double totalTargetArea = targetHighResArea + targetLowResArea + targetOpenArea + targetCommunityArea + targetOfficeArea + targetHotelArea;

    // Create GFA proportions based on the ratio of each target area to the total target area
    double gfaHighRes = gfa * (targetHighResArea / totalTargetArea);
    double gfaLowRes = gfa * (targetLowResArea / totalTargetArea);
    double gfaOpen = gfa * (targetOpenArea / totalTargetArea);
    double gfaCommunity = gfa * (targetCommunityArea / totalTargetArea);
    double gfaOffice = gfa * (targetOfficeArea / totalTargetArea);
    double gfaHotel = gfa * (targetHotelArea / totalTargetArea);

    // Proportionate areas based on target percentage
    double highResRatio = targetHighResArea / totalTargetArea;
    double lowResRatio = targetLowResArea / totalTargetArea;
    double openRatio = targetOpenArea / totalTargetArea;
    double communityRatio = targetCommunityArea / totalTargetArea;
    double officeRatio = targetOfficeArea / totalTargetArea;
    double hotelRatio = targetHotelArea / totalTargetArea;

    // Create a list of available areas (a copy of curveAreas)
    List<double> availableAreas = new List<double>(curveAreas);

    // Assign areas to each target based on their proportional target area
    List<double> selectedHighResAreas = AssignProportionalAreas(targetHighResArea, availableAreas);
    List<double> selectedLowResAreas = AssignProportionalAreas(targetLowResArea, availableAreas);
    List<double> selectedOpenAreas = AssignProportionalAreas(targetOpenArea, availableAreas);
    List<double> selectedCommunityAreas = AssignProportionalAreas(targetCommunityArea, availableAreas);
    List<double> selectedOfficeAreas = AssignProportionalAreas(targetOfficeArea, availableAreas);
    List<double> selectedHotelAreas = AssignProportionalAreas(targetHotelArea, availableAreas);

    // Assign random percentages to each selected areas list
    List<double> highResPercentages = AssignRandomPercentages(selectedHighResAreas);
    List<double> lowResPercentages = AssignRandomPercentages(selectedLowResAreas);
    List<double> openPercentages = AssignRandomPercentages(selectedOpenAreas);
    List<double> communityPercentages = AssignRandomPercentages(selectedCommunityAreas);
    List<double> officePercentages = AssignRandomPercentages(selectedOfficeAreas);
    List<double> hotelPercentages = AssignRandomPercentages(selectedHotelAreas);

    // Calculate GFA for each program by applying percentages to selected areas
    List<double> highResGFA = CalculateCurveGFA(gfaHighRes, highResPercentages, selectedHighResAreas);
    List<double> lowResGFA = CalculateCurveGFA(gfaLowRes, lowResPercentages, selectedLowResAreas);
    List<double> openGFA = CalculateCurveGFA(gfaOpen, openPercentages, selectedOpenAreas);
    List<double> communityGFA = CalculateCurveGFA(gfaCommunity, communityPercentages, selectedCommunityAreas);
    List<double> officeGFA = CalculateCurveGFA(gfaOffice, officePercentages, selectedOfficeAreas);
    List<double> hotelGFA = CalculateCurveGFA(gfaHotel, hotelPercentages, selectedHotelAreas);

    // Calculate and round up GFA for each program by dividing by the selected curve areas
    List<int> highResRoundedGFA = CalculateRoundedGFA(highResGFA, selectedHighResAreas);
    List<int> lowResRoundedGFA = CalculateRoundedGFA(lowResGFA, selectedLowResAreas);
    List<int> openRoundedGFA = CalculateRoundedGFA(openGFA, selectedOpenAreas);
    List<int> communityRoundedGFA = CalculateRoundedGFA(communityGFA, selectedCommunityAreas);
    List<int> officeRoundedGFA = CalculateRoundedGFA(officeGFA, selectedOfficeAreas);
    List<int> hotelRoundedGFA = CalculateRoundedGFA(hotelGFA, selectedHotelAreas);

    // Define extrusion height (8 units)
    double extrusionHeight = 8.0;

    // Create corresponding curve lists for each selected area list
    List<Curve> highResCurves = ExtractSelectedCurves(curves, selectedHighResAreas, curveAreas);
    List<Curve> lowResCurves = ExtractSelectedCurves(curves, selectedLowResAreas, curveAreas);
    List<Curve> openCurves = ExtractSelectedCurves(curves, selectedOpenAreas, curveAreas);
    List<Curve> communityCurves = ExtractSelectedCurves(curves, selectedCommunityAreas, curveAreas);
    List<Curve> officeCurves = ExtractSelectedCurves(curves, selectedOfficeAreas, curveAreas);
    List<Curve> hotelCurves = ExtractSelectedCurves(curves, selectedHotelAreas, curveAreas);

    // Extrude and cap curves for each program category by 8 units
    List<Brep> highResExtrusions = ExtrudeAndCapCurves(highResCurves, extrusionHeight);
    List<Brep> lowResExtrusions = ExtrudeAndCapCurves(lowResCurves, extrusionHeight);
    List<Brep> openExtrusions = ExtrudeAndCapCurves(openCurves, extrusionHeight);
    List<Brep> communityExtrusions = ExtrudeAndCapCurves(communityCurves, extrusionHeight);
    List<Brep> officeExtrusions = ExtrudeAndCapCurves(officeCurves, extrusionHeight);
    List<Brep> hotelExtrusions = ExtrudeAndCapCurves(hotelCurves, extrusionHeight);

    // Define the extrusion height for each stack level (8 units per extrusion as before)
    double stackHeight = 8.0;

    // Stack extrusions for each program category based on rounded GFA values
    List<Brep> highResStackedExtrusions = StackExtrusions(highResExtrusions, highResRoundedGFA, stackHeight);
    List<Brep> lowResStackedExtrusions = StackExtrusions(lowResExtrusions, lowResRoundedGFA, stackHeight);
    List<Brep> openStackedExtrusions = StackExtrusions(openExtrusions, openRoundedGFA, stackHeight);
    List<Brep> communityStackedExtrusions = StackExtrusions(communityExtrusions, communityRoundedGFA, stackHeight);
    List<Brep> officeStackedExtrusions = StackExtrusions(officeExtrusions, officeRoundedGFA, stackHeight);
    List<Brep> hotelStackedExtrusions = StackExtrusions(hotelExtrusions, hotelRoundedGFA, stackHeight);

    // Output the selected areas for each category
    B = selectedHighResAreas;
    C = selectedLowResAreas;
    D = selectedOpenAreas;
    E = selectedCommunityAreas;
    F = selectedOfficeAreas;
    G = selectedHotelAreas;

    // Output the GFA for each target
    H = gfaHighRes;
    I = gfaLowRes;
    J = gfaOpen;
    K = gfaCommunity;
    L = gfaOffice;
    M = gfaHotel;

    // Output the percentage values
    N = highResPercentages;
    O = lowResPercentages;
    P = openPercentages;
    Q = communityPercentages;
    R = officePercentages;
    S = hotelPercentages;

    // Output the GFA for each selected curve list
    T = highResGFA;
    U = lowResGFA;
    V = openGFA;
    W = communityGFA;
    X = officeGFA;
    Y = hotelGFA;

    // Output the rounded GFA values for each program
    Z = highResRoundedGFA;
    AA = lowResRoundedGFA;
    AB = openRoundedGFA;
    AC = communityRoundedGFA;
    AD = officeRoundedGFA;
    AE = hotelRoundedGFA;

    // Output the extruded and capped Breps
    AF = highResExtrusions;
    AG = lowResExtrusions;
    AH = openExtrusions;
    AI = communityExtrusions;
    AJ = officeExtrusions;
    AK = hotelExtrusions;

    // Output the stacked extrusions for each program category
    AL = highResStackedExtrusions;
    AM = lowResStackedExtrusions;
    AN = openStackedExtrusions;
    AO = communityStackedExtrusions;
    AP = officeStackedExtrusions;
    AQ = hotelStackedExtrusions;
# ---------- c_script_5: C# additional code ----------
  // Helper function to assign areas proportionally
  List<double> AssignProportionalAreas(double targetArea, List<double> availableAreas)
  {
    double accumulatedArea = 0.0;
    List<double> selectedAreas = new List<double>();
    Random random = new Random();

    while (accumulatedArea < targetArea && availableAreas.Count > 0)
    {
      // Pick a random index from the available areas
      int randomIndex = random.Next(availableAreas.Count);
      double selectedArea = availableAreas[randomIndex];

      // Add the selected area to the accumulated area
      accumulatedArea += selectedArea;
      selectedAreas.Add(selectedArea);

      // Remove the selected area from the available list to avoid repetition
      availableAreas.RemoveAt(randomIndex);

      // Break if accumulated area exceeds or meets the target
      if (accumulatedArea >= targetArea)
      {
        break;
      }
    }

    return selectedAreas;
  }

  // Helper function to assign area lists a percentage
  List<double> AssignRandomPercentages(List<double> selectedAreas)
  {
    Random random = new Random();
    List<double> randomValues = new List<double>();
    double totalRandom = 0.0;

    // Generate random values for each area
    foreach (var area in selectedAreas)
    {
      double randValue = random.NextDouble(); // Generate random number between 0 and 1
      randomValues.Add(randValue);
      totalRandom += randValue; // Sum up all random values
    }

    // Normalize the random values so their sum is 100%
    List<double> percentageValues = new List<double>();
    foreach (var randValue in randomValues)
    {
      double percentage = (randValue / totalRandom) * 100.0; // Convert to percentage
      percentageValues.Add(percentage);
    }

    return percentageValues;
  }

  // Helper function to calculate GFA based on percentage assigned to each curve area
  List<double> CalculateCurveGFA(double gfa, List<double> percentages, List<double> selectedAreas)
  {
    List<double> curveGFA = new List<double>();

    for (int i = 0; i < percentages.Count; i++)
    {
      // Divide GFA by 100 and multiply by the percentage
      double areaGFA = (gfa / 100.0) * percentages[i];
      curveGFA.Add(areaGFA);
    }

    return curveGFA;
  }

  // Helper function to calculate and round up the division of GFA by area
  List<int> CalculateRoundedGFA(List<double> gfaList, List<double> areaList)
  {
    List<int> roundedGFA = new List<int>();

    for (int i = 0; i < gfaList.Count; i++)
    {
      // Avoid division by zero by checking if area is greater than 0
      if (areaList[i] > 0)
      {
        // Divide GFA by area and round up to the nearest whole number
        double divisionResult = gfaList[i] / areaList[i];
        int roundedValue = (int) Math.Ceiling(divisionResult); // Round up
        roundedGFA.Add(roundedValue);
      }
      else
      {
        roundedGFA.Add(0); // If area is 0, add 0 to the result
      }
    }

    return roundedGFA;
  }

  // Helper function to extract corresponding curves based on selected areas
  List<Curve> ExtractSelectedCurves(List<Curve> originalCurves, List<double> selectedAreas, List<double> originalAreas)
  {
    List<Curve> selectedCurves = new List<Curve>();

    foreach (double selectedArea in selectedAreas)
    {
      // Find the corresponding curve in the original list by matching the area
      int index = originalAreas.IndexOf(selectedArea);
      if (index >= 0 && index < originalCurves.Count)
      {
        selectedCurves.Add(originalCurves[index]);
        // Optionally remove the area from the original list to avoid duplicate selections
        originalAreas[index] = -1; // Mark this area as "used" by assigning -1
      }
    }

    return selectedCurves;
  }

  // Helper function to extrude and cap curves
  List<Brep> ExtrudeAndCapCurves(List<Curve> curves, double extrusionHeight)
  {
    List<Brep> extrudedBreps = new List<Brep>();

    foreach (Curve curve in curves)
    {
      if (curve.IsClosed)
      {
        // Create an extrusion vector (in the Z direction, with height)
        Vector3d extrusionVector = new Vector3d(0, 0, extrusionHeight);

        // Create the extrusion surface
        Surface extrusionSurface = Surface.CreateExtrusion(curve, extrusionVector);

        if (extrusionSurface != null)
        {
          Brep extrusionBrep = extrusionSurface.ToBrep();
          Brep cappedBrep = extrusionBrep.CapPlanarHoles(0.01); // Cap the Brep

          if (cappedBrep != null)
          {
            extrudedBreps.Add(cappedBrep);
          }
        }
      }
    }

    return extrudedBreps;
  }

  // Helper function to stack extrusions based on rounded GFA values
  List<Brep> StackExtrusions(List<Brep> extrusions, List<int> roundedGFA, double extrusionHeight)
  {
    List<Brep> stackedBreps = new List<Brep>();

    // Loop through each extrusion and corresponding GFA value
    for (int i = 0; i < extrusions.Count; i++)
    {
      Brep originalBrep = extrusions[i];
      int stackCount = roundedGFA[i]; // Get the rounded GFA value for this curve

      // Stack the extrusion the number of times given by the rounded GFA
      for (int j = 0; j < stackCount; j++)
      {
        // Create a translation vector to move the extrusion upward
        Vector3d translationVector = new Vector3d(0, 0, extrusionHeight * j);

        // Create a transformation for the translation
        Transform translationTransform = Transform.Translation(translationVector);

        // Make a copy of the original brep
        Brep transformedBrep = originalBrep.DuplicateBrep();

        // Apply the transformation to the duplicated brep
        transformedBrep.Transform(translationTransform);

        // Add the transformed brep to the list of stacked Breps
        stackedBreps.Add(transformedBrep);
      }
    }

    return stackedBreps;
  }
# ---------- end c_script_5 ----------
openbmp = OpenBitmap(FilePath=path, Load=True)
parse_json_string = ParseJSONString(Text=ghpython_script)

# ---- group: Clean Image Bitmap
shape_edge_tolerance = Slider(1, range=0..1)
pixel_sample_size = Slider(400, range=0..400)

# ----
c_script_6 = CSharpScript()  # -> out, A, B, C, D, E, F, G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; inputs curves: list of Curve, gfa: Double, targetHighResArea: Double, targetLowResArea: Double, targetOpenArea: Double, targetCommunityArea: Double, targetOfficeArea: Double, targetHotelArea: Double
# ---------- c_script_6: C# ----------
    // Create a list to store the areas of closed curves
    List<double> curveAreas = new List<double>();

    // Iterate through each curve in the input list
    foreach (Curve curve in curves)
    {
      // Check if the curve is closed
      if (curve.IsClosed)
      {
        // Compute the area of the closed curve
        AreaMassProperties areaProps = AreaMassProperties.Compute(curve);

        // If the computation is successful, store the area in the list
        if (areaProps != null)
        {
          curveAreas.Add(areaProps.Area);
        }
        else
        {
          curveAreas.Add(0.0); // Add 0 if the area computation fails
        }
      }
      else
      {
        curveAreas.Add(0.0); // Add 0 if the curve is not closed
      }
    }

    // Output the list of areas to 'A'
    A = curveAreas;

    // Calculate the total sum of all areas
    double totalArea = curveAreas.Sum();

    // Calculate the total target area
    double totalTargetArea = targetHighResArea + targetLowResArea + targetOpenArea + targetCommunityArea + targetOfficeArea + targetHotelArea;

    // Create GFA proportions based on the ratio of each target area to the total target area
    double gfaHighRes = gfa * (targetHighResArea / totalTargetArea);
    double gfaLowRes = gfa * (targetLowResArea / totalTargetArea);
    double gfaOpen = gfa * (targetOpenArea / totalTargetArea);
    double gfaCommunity = gfa * (targetCommunityArea / totalTargetArea);
    double gfaOffice = gfa * (targetOfficeArea / totalTargetArea);
    double gfaHotel = gfa * (targetHotelArea / totalTargetArea);

    // Proportionate areas based on target percentage
    double highResRatio = targetHighResArea / totalTargetArea;
    double lowResRatio = targetLowResArea / totalTargetArea;
    double openRatio = targetOpenArea / totalTargetArea;
    double communityRatio = targetCommunityArea / totalTargetArea;
    double officeRatio = targetOfficeArea / totalTargetArea;
    double hotelRatio = targetHotelArea / totalTargetArea;

    // Create a list of available areas (a copy of curveAreas)
    List<double> availableAreas = new List<double>(curveAreas);

    // Assign areas to each target based on their proportional target area
    List<double> selectedHighResAreas = AssignProportionalAreas(targetHighResArea, availableAreas);
    List<double> selectedLowResAreas = AssignProportionalAreas(targetLowResArea, availableAreas);
    List<double> selectedOpenAreas = AssignProportionalAreas(targetOpenArea, availableAreas);
    List<double> selectedCommunityAreas = AssignProportionalAreas(targetCommunityArea, availableAreas);
    List<double> selectedOfficeAreas = AssignProportionalAreas(targetOfficeArea, availableAreas);
    List<double> selectedHotelAreas = AssignProportionalAreas(targetHotelArea, availableAreas);

    // Assign random percentages to each selected areas list
    List<double> highResPercentages = AssignRandomPercentages(selectedHighResAreas);
    List<double> lowResPercentages = AssignRandomPercentages(selectedLowResAreas);
    List<double> openPercentages = AssignRandomPercentages(selectedOpenAreas);
    List<double> communityPercentages = AssignRandomPercentages(selectedCommunityAreas);
    List<double> officePercentages = AssignRandomPercentages(selectedOfficeAreas);
    List<double> hotelPercentages = AssignRandomPercentages(selectedHotelAreas);

    // Calculate GFA for each program by applying percentages to selected areas
    List<double> highResGFA = CalculateCurveGFA(gfaHighRes, highResPercentages, selectedHighResAreas);
    List<double> lowResGFA = CalculateCurveGFA(gfaLowRes, lowResPercentages, selectedLowResAreas);
    List<double> openGFA = CalculateCurveGFA(gfaOpen, openPercentages, selectedOpenAreas);
    List<double> communityGFA = CalculateCurveGFA(gfaCommunity, communityPercentages, selectedCommunityAreas);
    List<double> officeGFA = CalculateCurveGFA(gfaOffice, officePercentages, selectedOfficeAreas);
    List<double> hotelGFA = CalculateCurveGFA(gfaHotel, hotelPercentages, selectedHotelAreas);

    // Calculate and round up GFA for each program by dividing by the selected curve areas
    List<int> highResRoundedGFA = CalculateRoundedGFA(highResGFA, selectedHighResAreas);
    List<int> lowResRoundedGFA = CalculateRoundedGFA(lowResGFA, selectedLowResAreas);
    List<int> openRoundedGFA = CalculateRoundedGFA(openGFA, selectedOpenAreas);
    List<int> communityRoundedGFA = CalculateRoundedGFA(communityGFA, selectedCommunityAreas);
    List<int> officeRoundedGFA = CalculateRoundedGFA(officeGFA, selectedOfficeAreas);
    List<int> hotelRoundedGFA = CalculateRoundedGFA(hotelGFA, selectedHotelAreas);

    // Define extrusion height (8 units)
    double extrusionHeight = 8.0;

    // Create corresponding curve lists for each selected area list
    List<Curve> highResCurves = ExtractSelectedCurves(curves, selectedHighResAreas, curveAreas);
    List<Curve> lowResCurves = ExtractSelectedCurves(curves, selectedLowResAreas, curveAreas);
    List<Curve> openCurves = ExtractSelectedCurves(curves, selectedOpenAreas, curveAreas);
    List<Curve> communityCurves = ExtractSelectedCurves(curves, selectedCommunityAreas, curveAreas);
    List<Curve> officeCurves = ExtractSelectedCurves(curves, selectedOfficeAreas, curveAreas);
    List<Curve> hotelCurves = ExtractSelectedCurves(curves, selectedHotelAreas, curveAreas);

    // Extrude and cap curves for each program category by 8 units
    List<Brep> highResExtrusions = ExtrudeAndCapCurves(highResCurves, extrusionHeight);
    List<Brep> lowResExtrusions = ExtrudeAndCapCurves(lowResCurves, extrusionHeight);
    List<Brep> openExtrusions = ExtrudeAndCapCurves(openCurves, extrusionHeight);
    List<Brep> communityExtrusions = ExtrudeAndCapCurves(communityCurves, extrusionHeight);
    List<Brep> officeExtrusions = ExtrudeAndCapCurves(officeCurves, extrusionHeight);
    List<Brep> hotelExtrusions = ExtrudeAndCapCurves(hotelCurves, extrusionHeight);

    // Define the extrusion height for each stack level (8 units per extrusion as before)
    double stackHeight = 8.0;

    // Stack extrusions for each program category based on rounded GFA values
    List<Brep> highResStackedExtrusions = StackExtrusions(highResExtrusions, highResRoundedGFA, stackHeight);
    List<Brep> lowResStackedExtrusions = StackExtrusions(lowResExtrusions, lowResRoundedGFA, stackHeight);
    List<Brep> openStackedExtrusions = StackExtrusions(openExtrusions, openRoundedGFA, stackHeight);
    List<Brep> communityStackedExtrusions = StackExtrusions(communityExtrusions, communityRoundedGFA, stackHeight);
    List<Brep> officeStackedExtrusions = StackExtrusions(officeExtrusions, officeRoundedGFA, stackHeight);
    List<Brep> hotelStackedExtrusions = StackExtrusions(hotelExtrusions, hotelRoundedGFA, stackHeight);

    // Output the selected areas for each category
    B = selectedHighResAreas;
    C = selectedLowResAreas;
    D = selectedOpenAreas;
    E = selectedCommunityAreas;
    F = selectedOfficeAreas;
    G = selectedHotelAreas;

    // Output the GFA for each target
    H = gfaHighRes;
    I = gfaLowRes;
    J = gfaOpen;
    K = gfaCommunity;
    L = gfaOffice;
    M = gfaHotel;

    // Output the percentage values
    N = highResPercentages;
    O = lowResPercentages;
    P = openPercentages;
    Q = communityPercentages;
    R = officePercentages;
    S = hotelPercentages;

    // Output the GFA for each selected curve list
    T = highResGFA;
    U = lowResGFA;
    V = openGFA;
    W = communityGFA;
    X = officeGFA;
    Y = hotelGFA;

    // Output the rounded GFA values for each program
    Z = highResRoundedGFA;
    AA = lowResRoundedGFA;
    AB = openRoundedGFA;
    AC = communityRoundedGFA;
    AD = officeRoundedGFA;
    AE = hotelRoundedGFA;

    // Output the extruded and capped Breps
    AF = highResExtrusions;
    AG = lowResExtrusions;
    AH = openExtrusions;
    AI = communityExtrusions;
    AJ = officeExtrusions;
    AK = hotelExtrusions;

    // Output the stacked extrusions for each program category
    AL = highResStackedExtrusions;
    AM = lowResStackedExtrusions;
    AN = openStackedExtrusions;
    AO = communityStackedExtrusions;
    AP = officeStackedExtrusions;
    AQ = hotelStackedExtrusions;

    // Flatten all Brep lists into a single list
    List<Brep> allBreps = new List<Brep>();
    allBreps.AddRange(highResStackedExtrusions);
    allBreps.AddRange(lowResStackedExtrusions);
    allBreps.AddRange(openStackedExtrusions);
    allBreps.AddRange(communityStackedExtrusions);
    allBreps.AddRange(officeStackedExtrusions);
    allBreps.AddRange(hotelStackedExtrusions);

    //Convert each Brep to Mesh
    List<Mesh> meshList = new List<Mesh>();

    foreach (Brep brep in allBreps)
    {
      if (brep != null)
      {
        // Convert the brep to meshes
        Mesh[] brepMeshes = Mesh.CreateFromBrep(brep, MeshingParameters.Default);

        if (brepMeshes != null && brepMeshes.Length > 0)
        {
          // Add all meshes to the meshList
          meshList.AddRange(brepMeshes);
        }
      }
    }

    //Output the final list of meshes
    finalMeshes = meshList;
# ---------- c_script_6: C# additional code ----------
      // Helper function to assign areas proportionally
List<double> AssignProportionalAreas(double targetArea, List<double> availableAreas)
{
  double accumulatedArea = 0.0;
  List<double> selectedAreas = new List<double>();
  Random random = new Random();

  while (accumulatedArea < targetArea && availableAreas.Count > 0)
  {
    // Pick a random index from the available areas
    int randomIndex = random.Next(availableAreas.Count);
    double selectedArea = availableAreas[randomIndex];

    // Add the selected area to the accumulated area
    accumulatedArea += selectedArea;
    selectedAreas.Add(selectedArea);

    // Remove the selected area from the available list to avoid repetition
    availableAreas.RemoveAt(randomIndex);

    // Break if accumulated area exceeds or meets the target
    if (accumulatedArea >= targetArea)
    {
      break;
    }
  }

  return selectedAreas;
}

  // Helper function to assign area lists a percentage
List<double> AssignRandomPercentages(List<double> selectedAreas)
{
  Random random = new Random();
  List<double> randomValues = new List<double>();
  double totalRandom = 0.0;

  // Generate random values for each area
  foreach (var area in selectedAreas)
  {
    double randValue = random.NextDouble(); // Generate random number between 0 and 1
    randomValues.Add(randValue);
    totalRandom += randValue; // Sum up all random values
  }

  // Normalize the random values so their sum is 100%
  List<double> percentageValues = new List<double>();
  foreach (var randValue in randomValues)
  {
    double percentage = (randValue / totalRandom) * 100.0; // Convert to percentage
    percentageValues.Add(percentage);
  }

  return percentageValues;
}

  // Helper function to calculate GFA based on percentage assigned to each curve area
List<double> CalculateCurveGFA(double gfa, List<double> percentages, List<double> selectedAreas)
{
  List<double> curveGFA = new List<double>();

  for (int i = 0; i < percentages.Count; i++)
  {
    // Divide GFA by 100 and multiply by the percentage
    double areaGFA = (gfa / 100.0) * percentages[i];
    curveGFA.Add(areaGFA);
  }

  return curveGFA;
}

  // Helper function to calculate and round up the division of GFA by area
List<int> CalculateRoundedGFA(List<double> gfaList, List<double> areaList)
{
  List<int> roundedGFA = new List<int>();

  for (int i = 0; i < gfaList.Count; i++)
  {
    // Avoid division by zero by checking if area is greater than 0
    if (areaList[i] > 0)
    {
      // Divide GFA by area and round up to the nearest whole number
      double divisionResult = gfaList[i] / areaList[i];
      int roundedValue = (int) Math.Ceiling(divisionResult); // Round up
      roundedGFA.Add(roundedValue);
    }
    else
    {
      roundedGFA.Add(0); // If area is 0, add 0 to the result
    }
  }

  return roundedGFA;
}

  // Helper function to extract corresponding curves based on selected areas
List<Curve> ExtractSelectedCurves(List<Curve> originalCurves, List<double> selectedAreas, List<double> originalAreas)
{
  List<Curve> selectedCurves = new List<Curve>();

  foreach (double selectedArea in selectedAreas)
  {
    // Find the corresponding curve in the original list by matching the area
    int index = originalAreas.IndexOf(selectedArea);
    if (index >= 0 && index < originalCurves.Count)
    {
      selectedCurves.Add(originalCurves[index]);
      // Optionally remove the area from the original list to avoid duplicate selections
      originalAreas[index] = -1; // Mark this area as "used" by assigning -1
    }
  }

  return selectedCurves;
}

  // Helper function to extrude and cap curves
List<Brep> ExtrudeAndCapCurves(List<Curve> curves, double extrusionHeight)
{
  List<Brep> extrudedBreps = new List<Brep>();

  foreach (Curve curve in curves)
  {
    if (curve.IsClosed)
    {
      // Create an extrusion vector (in the Z direction, with height)
      Vector3d extrusionVector = new Vector3d(0, 0, extrusionHeight);

      // Create the extrusion surface
      Surface extrusionSurface = Surface.CreateExtrusion(curve, extrusionVector);

      if (extrusionSurface != null)
      {
        Brep extrusionBrep = extrusionSurface.ToBrep();
        Brep cappedBrep = extrusionBrep.CapPlanarHoles(0.01); // Cap the Brep

        if (cappedBrep != null)
        {
          extrudedBreps.Add(cappedBrep);
        }
      }
    }
  }

  return extrudedBreps;
}

  // Helper function to stack extrusions based on rounded GFA values
List<Brep> StackExtrusions(List<Brep> extrusions, List<int> roundedGFA, double extrusionHeight)
{
  List<Brep> stackedBreps = new List<Brep>();

  // Loop through each extrusion and corresponding GFA value
  for (int i = 0; i < extrusions.Count; i++)
  {
    Brep originalBrep = extrusions[i];
    int stackCount = roundedGFA[i]; // Get the rounded GFA value for this curve

    // Stack the extrusion the number of times given by the rounded GFA
    for (int j = 0; j < stackCount; j++)
    {
      // Create a translation vector to move the extrusion upward
      Vector3d translationVector = new Vector3d(0, 0, extrusionHeight * j);

      // Create a transformation for the translation
      Transform translationTransform = Transform.Translation(translationVector);

      // Make a copy of the original brep
      Brep transformedBrep = originalBrep.DuplicateBrep();

      // Apply the transformation to the duplicated brep
      transformedBrep.Transform(translationTransform);

      // Add the transformed brep to the list of stacked Breps
      stackedBreps.Add(transformedBrep);
    }
  }

  return stackedBreps;
}
# ---------- end c_script_6 ----------
panel = Panel("https://irs6qw8gvhdiverx.us-east-1.aws.endpoints.huggingface.cloud")
create_text_body = CreateTextBody(
    Content=parse_json_string,
    IsHtmlChecked=False,
    IsJavascriptChecked=False,
    IsJsonChecked=True,
    IsTextChecked=False,
    IsXmlChecked=False)
trace = TraceBitmap(Image=openbmp, Mode=0, Size=pixel_sample_size, Error=1, Threshold=0.9, Alpha=shape_edge_tolerance)
export_directory = Panel("C:\Users\EJain\OneDrive - Thornton Tomasetti, Inc\Desktop\AECTech_Eesha\Datastabledifusion")
post = POSTRequest(URL=panel, Body=create_text_body)  # -> Status, Content, Response
crv = Curve(trace)
pjs = ParseJSONString(Text=post.Content)
area = Area(Geometry=crv)  # -> Area, Centroid

# ---- group: Land Use %
community = Slider(10, range=1..101)
hotel = Slider(15, range=1..101)
low_residential = Slider(25, range=1..101)
office = Slider(10, range=1..101)
high_residential = Slider(20, range=1..101)
open_space = Slider(20, range=0..100)

# ---- group: Change Geometry
rotation = Slider(0, range=-180..180)

# ----
rjv = ReadJSONValue(JValue=pjs)  # -> AsString, AsNumber, AsBool
lng = ListLength(List=post.Content)
ma = MassAddition(Input=area.Area)  # -> Result, PartialResults
b64ba = Base64ToByteArray(Base64=rjv.AsString)
gguid = GenerateGUID(Generate=lng, Format="D")
concat = Concatenate(FragmentA=export_directory, FragmentB="\", FragmentC=gguid, FragmentD=".png")
baf = ByteArrayToFile(ByteArray=b64ba, Path=concat)
c_script_7 = CSharpScript(
    community=community,
    hotel=hotel,
    lowRes=low_residential,
    highRes=high_residential,
    openSpace=open_space,
    office=office,
    totalArea=ma.Result)  # -> out, percentageCommunity, percentageHotel, percentageLowRes, percentageHighRes, percentageOpenSpace, percentageOffice, A; inputs community: Double, hotel: Double, lowRes: Double, highRes: Double, openSpace: Double, office: Double, totalArea: Double
# ---------- c_script_7: C# ----------
    // Calculate the total percentage of all inputs
    double totalPercentage = community + hotel + lowRes + highRes + openSpace + office;
    string errorMessage = "";

    // Check if the total percentage is less than or equal to 100
    if (totalPercentage <= 100)
    {
      errorMessage = "Yes";
    }
    else
    {
      errorMessage = "No";
    }

    // If total percentage is valid, calculate the percentages based on the total area
    if (errorMessage == "Yes")
    {
      // Calculate the percentage values based on total area
      percentageCommunity = (community / 100) * totalArea;
      percentageHotel = (hotel/ 100) * totalArea;
      percentageLowRes = (lowRes/ 100) * totalArea;
      percentageHighRes = (highRes/ 100) * totalArea;
      percentageOpenSpace = (openSpace/ 100) * totalArea;
      percentageOffice = (office/ 100) * totalArea;
    }
    else
    {
      // If total percentage exceeds 100, set percentage outputs to 0 or handle accordingly
      percentageCommunity = 0;
      percentageHotel = 0;
      percentageLowRes = 0;
      percentageHighRes = 0;
      percentageOpenSpace = 0;
      percentageOffice = 0;
    }

    // Output the error message
    A = errorMessage;
# ---------- end c_script_7 ----------
textinput_2 = DirectTextInput(maxlength=10000, text="2000000")
c_script_8 = CSharpScript(
    curves=crv,
    gfa=textinput_2,
    targetHighResArea=c_script_7.percentageHighRes,
    targetLowResArea=c_script_7.percentageLowRes,
    targetOpenArea=c_script_7.percentageOpenSpace,
    targetCommunityArea=c_script_7.percentageCommunity,
    targetOfficeArea=c_script_7.percentageOffice,
    targetHotelArea=c_script_7.percentageHotel)  # -> out, finalMeshes; inputs curves: list of Curve, gfa: Double, targetHighResArea: Double, targetLowResArea: Double, targetOpenArea: Double, targetCommunityArea: Double, targetOfficeArea: Double, targetHotelArea: Double
# ---------- c_script_8: C# ----------
    // Create a list to store the areas of closed curves
    List<double> curveAreas = new List<double>();

    // Iterate through each curve in the input list
    foreach (Curve curve in curves)
    {
      // Check if the curve is closed
      if (curve.IsClosed)
      {
        // Compute the area of the closed curve
        AreaMassProperties areaProps = AreaMassProperties.Compute(curve);

        // If the computation is successful, store the area in the list
        if (areaProps != null)
        {
          curveAreas.Add(areaProps.Area);
        }
        else
        {
          curveAreas.Add(0.0); // Add 0 if the area computation fails
        }
      }
      else
      {
        curveAreas.Add(0.0); // Add 0 if the curve is not closed
      }
    }

    // Calculate the total sum of all areas
    double totalArea = curveAreas.Sum();

    // Calculate the total target area
    double totalTargetArea = targetHighResArea + targetLowResArea + targetOpenArea + targetCommunityArea + targetOfficeArea + targetHotelArea;

    // Create GFA proportions based on the ratio of each target area to the total target area
    double gfaHighRes = gfa * (targetHighResArea / totalTargetArea);
    double gfaLowRes = gfa * (targetLowResArea / totalTargetArea);
    double gfaOpen = gfa * (targetOpenArea / totalTargetArea);
    double gfaCommunity = gfa * (targetCommunityArea / totalTargetArea);
    double gfaOffice = gfa * (targetOfficeArea / totalTargetArea);
    double gfaHotel = gfa * (targetHotelArea / totalTargetArea);

    // Proportionate areas based on target percentage
    double highResRatio = targetHighResArea / totalTargetArea;
    double lowResRatio = targetLowResArea / totalTargetArea;
    double openRatio = targetOpenArea / totalTargetArea;
    double communityRatio = targetCommunityArea / totalTargetArea;
    double officeRatio = targetOfficeArea / totalTargetArea;
    double hotelRatio = targetHotelArea / totalTargetArea;

    // Create a list of available areas (a copy of curveAreas)
    List<double> availableAreas = new List<double>(curveAreas);

    // Assign areas to each target based on their proportional target area
    List<double> selectedHighResAreas = AssignProportionalAreas(targetHighResArea, availableAreas);
    List<double> selectedLowResAreas = AssignProportionalAreas(targetLowResArea, availableAreas);
    List<double> selectedOpenAreas = AssignProportionalAreas(targetOpenArea, availableAreas);
    List<double> selectedCommunityAreas = AssignProportionalAreas(targetCommunityArea, availableAreas);
    List<double> selectedOfficeAreas = AssignProportionalAreas(targetOfficeArea, availableAreas);
    List<double> selectedHotelAreas = AssignProportionalAreas(targetHotelArea, availableAreas);

    // Assign random percentages to each selected areas list
    List<double> highResPercentages = AssignRandomPercentages(selectedHighResAreas);
    List<double> lowResPercentages = AssignRandomPercentages(selectedLowResAreas);
    List<double> openPercentages = AssignRandomPercentages(selectedOpenAreas);
    List<double> communityPercentages = AssignRandomPercentages(selectedCommunityAreas);
    List<double> officePercentages = AssignRandomPercentages(selectedOfficeAreas);
    List<double> hotelPercentages = AssignRandomPercentages(selectedHotelAreas);

    // Calculate GFA for each program by applying percentages to selected areas
    List<double> highResGFA = CalculateCurveGFA(gfaHighRes, highResPercentages, selectedHighResAreas);
    List<double> lowResGFA = CalculateCurveGFA(gfaLowRes, lowResPercentages, selectedLowResAreas);
    List<double> openGFA = CalculateCurveGFA(gfaOpen, openPercentages, selectedOpenAreas);
    List<double> communityGFA = CalculateCurveGFA(gfaCommunity, communityPercentages, selectedCommunityAreas);
    List<double> officeGFA = CalculateCurveGFA(gfaOffice, officePercentages, selectedOfficeAreas);
    List<double> hotelGFA = CalculateCurveGFA(gfaHotel, hotelPercentages, selectedHotelAreas);

    // Calculate and round up GFA for each program by dividing by the selected curve areas
    List<int> highResRoundedGFA = CalculateRoundedGFA(highResGFA, selectedHighResAreas);
    List<int> lowResRoundedGFA = CalculateRoundedGFA(lowResGFA, selectedLowResAreas);
    List<int> openRoundedGFA = CalculateRoundedGFA(openGFA, selectedOpenAreas);
    List<int> communityRoundedGFA = CalculateRoundedGFA(communityGFA, selectedCommunityAreas);
    List<int> officeRoundedGFA = CalculateRoundedGFA(officeGFA, selectedOfficeAreas);
    List<int> hotelRoundedGFA = CalculateRoundedGFA(hotelGFA, selectedHotelAreas);

    // Define extrusion height (8 units)
    double extrusionHeight = 8.0;

    // Create corresponding curve lists for each selected area list
    List<Curve> highResCurves = ExtractSelectedCurves(curves, selectedHighResAreas, curveAreas);
    List<Curve> lowResCurves = ExtractSelectedCurves(curves, selectedLowResAreas, curveAreas);
    List<Curve> openCurves = ExtractSelectedCurves(curves, selectedOpenAreas, curveAreas);
    List<Curve> communityCurves = ExtractSelectedCurves(curves, selectedCommunityAreas, curveAreas);
    List<Curve> officeCurves = ExtractSelectedCurves(curves, selectedOfficeAreas, curveAreas);
    List<Curve> hotelCurves = ExtractSelectedCurves(curves, selectedHotelAreas, curveAreas);

    // Extrude and cap curves for each program category by 8 units
    List<Brep> highResExtrusions = ExtrudeAndCapCurves(highResCurves, extrusionHeight);
    List<Brep> lowResExtrusions = ExtrudeAndCapCurves(lowResCurves, extrusionHeight);
    List<Brep> openExtrusions = ExtrudeAndCapCurves(openCurves, extrusionHeight);
    List<Brep> communityExtrusions = ExtrudeAndCapCurves(communityCurves, extrusionHeight);
    List<Brep> officeExtrusions = ExtrudeAndCapCurves(officeCurves, extrusionHeight);
    List<Brep> hotelExtrusions = ExtrudeAndCapCurves(hotelCurves, extrusionHeight);

    // Define the extrusion height for each stack level (8 units per extrusion as before)
    double stackHeight = 8.0;

    // Stack extrusions for each program category based on rounded GFA values
    List<Brep> highResStackedExtrusions = StackExtrusions(highResExtrusions, highResRoundedGFA, stackHeight);
    List<Brep> lowResStackedExtrusions = StackExtrusions(lowResExtrusions, lowResRoundedGFA, stackHeight);
    List<Brep> openStackedExtrusions = StackExtrusions(openExtrusions, openRoundedGFA, stackHeight);
    List<Brep> communityStackedExtrusions = StackExtrusions(communityExtrusions, communityRoundedGFA, stackHeight);
    List<Brep> officeStackedExtrusions = StackExtrusions(officeExtrusions, officeRoundedGFA, stackHeight);
    List<Brep> hotelStackedExtrusions = StackExtrusions(hotelExtrusions, hotelRoundedGFA, stackHeight);

    // Flatten all Brep lists into a single list
    List<Brep> allBreps = new List<Brep>();
    allBreps.AddRange(highResStackedExtrusions);
    allBreps.AddRange(lowResStackedExtrusions);
    allBreps.AddRange(openStackedExtrusions);
    allBreps.AddRange(communityStackedExtrusions);
    allBreps.AddRange(officeStackedExtrusions);
    allBreps.AddRange(hotelStackedExtrusions);

    //Convert each Brep to Mesh
    List<Mesh> meshList = new List<Mesh>();

    foreach (Brep brep in allBreps)
    {
      if (brep != null)
      {
        // Convert the brep to meshes
        Mesh[] brepMeshes = Mesh.CreateFromBrep(brep, MeshingParameters.Default);

        if (brepMeshes != null && brepMeshes.Length > 0)
        {
          // Add all meshes to the meshList
          meshList.AddRange(brepMeshes);
        }
      }
    }

    //Output the final list of meshes
    finalMeshes = meshList;
# ---------- c_script_8: C# additional code ----------
  // Helper function to assign areas proportionally
  List<double> AssignProportionalAreas(double targetArea, List<double> availableAreas)
  {
    double accumulatedArea = 0.0;
    List<double> selectedAreas = new List<double>();
    Random random = new Random();

    while (accumulatedArea < targetArea && availableAreas.Count > 0)
    {
      // Pick a random index from the available areas
      int randomIndex = random.Next(availableAreas.Count);
      double selectedArea = availableAreas[randomIndex];

      // Add the selected area to the accumulated area
      accumulatedArea += selectedArea;
      selectedAreas.Add(selectedArea);

      // Remove the selected area from the available list to avoid repetition
      availableAreas.RemoveAt(randomIndex);

      // Break if accumulated area exceeds or meets the target
      if (accumulatedArea >= targetArea)
      {
        break;
      }
    }

    return selectedAreas;
  }

  // Helper function to assign area lists a percentage
  List<double> AssignRandomPercentages(List<double> selectedAreas)
  {
    Random random = new Random();
    List<double> randomValues = new List<double>();
    double totalRandom = 0.0;

    // Generate random values for each area
    foreach (var area in selectedAreas)
    {
      double randValue = random.NextDouble(); // Generate random number between 0 and 1
      randomValues.Add(randValue);
      totalRandom += randValue; // Sum up all random values
    }

    // Normalize the random values so their sum is 100%
    List<double> percentageValues = new List<double>();
    foreach (var randValue in randomValues)
    {
      double percentage = (randValue / totalRandom) * 100.0; // Convert to percentage
      percentageValues.Add(percentage);
    }

    return percentageValues;
  }

  // Helper function to calculate GFA based on percentage assigned to each curve area
  List<double> CalculateCurveGFA(double gfa, List<double> percentages, List<double> selectedAreas)
  {
    List<double> curveGFA = new List<double>();

    for (int i = 0; i < percentages.Count; i++)
    {
      // Divide GFA by 100 and multiply by the percentage
      double areaGFA = (gfa / 100.0) * percentages[i];
      curveGFA.Add(areaGFA);
    }

    return curveGFA;
  }

  // Helper function to calculate and round up the division of GFA by area
  List<int> CalculateRoundedGFA(List<double> gfaList, List<double> areaList)
  {
    List<int> roundedGFA = new List<int>();

    for (int i = 0; i < gfaList.Count; i++)
    {
      // Avoid division by zero by checking if area is greater than 0
      if (areaList[i] > 0)
      {
        // Divide GFA by area and round up to the nearest whole number
        double divisionResult = gfaList[i] / areaList[i];
        int roundedValue = (int) Math.Ceiling(divisionResult); // Round up
        roundedGFA.Add(roundedValue);
      }
      else
      {
        roundedGFA.Add(0); // If area is 0, add 0 to the result
      }
    }

    return roundedGFA;
  }

  // Helper function to extract corresponding curves based on selected areas
  List<Curve> ExtractSelectedCurves(List<Curve> originalCurves, List<double> selectedAreas, List<double> originalAreas)
  {
    List<Curve> selectedCurves = new List<Curve>();

    foreach (double selectedArea in selectedAreas)
    {
      // Find the corresponding curve in the original list by matching the area
      int index = originalAreas.IndexOf(selectedArea);
      if (index >= 0 && index < originalCurves.Count)
      {
        selectedCurves.Add(originalCurves[index]);
        // Optionally remove the area from the original list to avoid duplicate selections
        originalAreas[index] = -1; // Mark this area as "used" by assigning -1
      }
    }

    return selectedCurves;
  }

  // Helper function to extrude and cap curves
  List<Brep> ExtrudeAndCapCurves(List<Curve> curves, double extrusionHeight)
  {
    List<Brep> extrudedBreps = new List<Brep>();

    foreach (Curve curve in curves)
    {
      if (curve.IsClosed)
      {
        // Create an extrusion vector (in the Z direction, with height)
        Vector3d extrusionVector = new Vector3d(0, 0, extrusionHeight);

        // Create the extrusion surface
        Surface extrusionSurface = Surface.CreateExtrusion(curve, extrusionVector);

        if (extrusionSurface != null)
        {
          Brep extrusionBrep = extrusionSurface.ToBrep();
          Brep cappedBrep = extrusionBrep.CapPlanarHoles(0.01); // Cap the Brep

          if (cappedBrep != null)
          {
            extrudedBreps.Add(cappedBrep);
          }
        }
      }
    }

    return extrudedBreps;
  }

  // Helper function to stack extrusions based on rounded GFA values
  List<Brep> StackExtrusions(List<Brep> extrusions, List<int> roundedGFA, double extrusionHeight)
  {
    List<Brep> stackedBreps = new List<Brep>();

    // Loop through each extrusion and corresponding GFA value
    for (int i = 0; i < extrusions.Count; i++)
    {
      Brep originalBrep = extrusions[i];
      int stackCount = roundedGFA[i]; // Get the rounded GFA value for this curve

      // Stack the extrusion the number of times given by the rounded GFA
      for (int j = 0; j < stackCount; j++)
      {
        // Create a translation vector to move the extrusion upward
        Vector3d translationVector = new Vector3d(0, 0, extrusionHeight * j);

        // Create a transformation for the translation
        Transform translationTransform = Transform.Translation(translationVector);

        // Make a copy of the original brep
        Brep transformedBrep = originalBrep.DuplicateBrep();

        // Apply the transformation to the duplicated brep
        transformedBrep.Transform(translationTransform);

        // Add the transformed brep to the list of stacked Breps
        stackedBreps.Add(transformedBrep);
      }
    }

    return stackedBreps;
  }
# ---------- end c_script_8 ----------
mesh = Mesh(graft(c_script_8.finalMeshes))
panel_2 = Panel("""Low Residential %
High Residential %
Community %
Hotel %
Office %
Open Space %""")
panel_3 = Panel("""Shape Edge Tolerance
Pixel Sample Size""")
merge = Merge(Data1="Nolli Prompt", Data2=panel_2, Data3=panel_3, Data4="Rotate")
paramwidget = ParameterWidget(Parameters=merge)
paramwidget_2 = ParameterWidget(Parameters=merge)
tab = Tab(Name="Inputs", Icon="adjustments-horizontal", Widgets=paramwidget)
tab_2 = Tab(Name="Exports", Icon="download", Widgets=paramwidget_2)
merge_2 = Merge(Data1=tab, Data2=tab_2)
textwidget = TextWidget(Text="**NOLLI CANOLLI*")
container = Container(Name="left", Tabs=merge_2)
container_2 = Container(Name="top", Widgets=textwidget)
merge_3 = Merge(Data1=container, Data2=container_2)
app = App(Containers=merge_3)
